# Grasshopper definition Geometry_Box.gh (Grasshopper 1.0.7)
# plug-ins: RhinoCodePluginGH

# ----
# gpt-4 Text Prompt
# Geometry Box
# Use this script editor template to create a script
#  for the C# node in grasshopper for rhino8 that
# models geometry for
# 
# a geometry
# 
# and specifically to
# 
# create a Param box container
# 
# //Grasshopper Script Instance
# //#! csharp
# using System;
# using System.Collections;
# using System.Collections.Generic;
# using System.Drawing;
# 
# using Rhino;
# using Rhino.Geometry;
# 
# using Grasshopper;
# using Grasshopper.Kernel;
# using Grasshopper.Kernel.Data;
# using Grasshopper.Kernel.Types;
# 
# public class Script_Instance : GH_ScriptInstance
# {
#   /*
#     Members:
#       RhinoDoc RhinoDocument
#       GH_Document GrasshopperDocument
#       IGH_Component Component
#       int Iteration
# 
#     Methods (Virtual & overridable):
#       Print(string text)
#       Print(string format, params object[] args)
#       Reflect(object obj)
#       Reflect(object obj, string method_name)
#   */
# 
#   private void RunScript(object x, object y, out object a)
#   {
#     // Write your logic here
#     a = null;
#   }
# }
number_slider = Slider(0.89, range=0..10)
vector_xyz = VectorXYZ(XComponent=Slider(5.43, range=0..10), YComponent=Slider(4.18, range=0..10), ZComponent=Slider(4.18, range=0..10))  # -> Vector, Length
construct_point = ConstructPoint(XCoordinate=number_slider, YCoordinate=Slider(3.44, range=0..10), ZCoordinate=Slider(0, range=0..10))
geometry_box = Script(basePoint=construct_point, dimensions=vector_xyz.Vector)  # -> out, boxGeometry; inputs basePoint: Point3d, dimensions: Vector3d
# ---------- geometry_box: C# ----------
// Grasshopper Script Instance
using System;
using System.Collections;
using System.Collections.Generic;
using System.Drawing;

using Rhino;
using Rhino.Geometry;

using Grasshopper;
using Grasshopper.Kernel;
using Grasshopper.Kernel.Data;
using Grasshopper.Kernel.Types;

public class Script_Instance : GH_ScriptInstance
{
  private void RunScript(
	Point3d basePoint,
	Vector3d dimensions,
	out object boxGeometry)
  {
    // Checking if the dimensions are valid
    if(dimensions.X <= 0 || dimensions.Y <= 0 || dimensions.Z <= 0)
    {
      Print("Invalid dimensions! All values should be greater than zero.");
      boxGeometry = null;
      return;
    }

    // Creating a box based on the provided point and dimensions
    Plane basePlane = new Plane(basePoint, Vector3d.ZAxis);
    Interval xInterval = new Interval(0, dimensions.X);
    Interval yInterval = new Interval(0, dimensions.Y);
    Interval zInterval = new Interval(0, dimensions.Z);
    boxGeometry = new Box(basePlane, xInterval, yInterval, zInterval);
  }
}
# ---------- end geometry_box ----------
box = Box(geometry_box.boxGeometry)
panel = Panel(geometry_box.out)
panel_2 = Panel(box)
