# Grasshopper definition Geometry_Brep.gh (Grasshopper 1.0.7)
# plug-ins: RhinoCodePluginGH

# ----
# Geometry Brep
number_slider = Slider(3.63, range=0..10)
# gpt-4 Text Prompt
# Use this script editor template to create a script
#  for the C# node in grasshopper for rhino8 that
# models geometry for
# 
# a geometry
# 
# and specifically to
# 
# create a Param brep container
# 
# //Grasshopper Script Instance
# //#! csharp
# using System;
# using System.Collections;
# using System.Collections.Generic;
# using System.Drawing;
# 
# using Rhino;
# using Rhino.Geometry;
# 
# using Grasshopper;
# using Grasshopper.Kernel;
# using Grasshopper.Kernel.Data;
# using Grasshopper.Kernel.Types;
# 
# public class Script_Instance : GH_ScriptInstance
# {
#   /*
#     Members:
#       RhinoDoc RhinoDocument
#       GH_Document GrasshopperDocument
#       IGH_Component Component
#       int Iteration
# 
#     Methods (Virtual & overridable):
#       Print(string text)
#       Print(string format, params object[] args)
#       Reflect(object obj)
#       Reflect(object obj, string method_name)
#   */
# 
#   private void RunScript(object x, object y, out object a)
#   {
#     // Write your logic here
#     a = null;
#   }
# }
number_slider_2 = Slider(1.17, range=0..10)
center_box = CenterBox(Base=PlaneXY(0, 0, 0), X=number_slider_2, Y=number_slider, Z=Slider(3.12, range=0..10))
geometry_brep = Script(baseBrep=center_box)  # -> out, resultGeometry; inputs baseBrep: Brep
# ---------- geometry_brep: C# ----------
// Grasshopper Script Instance
using System;
using System.Collections;
using System.Collections.Generic;
using System.Drawing;

using Rhino;
using Rhino.Geometry;

using Grasshopper;
using Grasshopper.Kernel;
using Grasshopper.Kernel.Data;
using Grasshopper.Kernel.Types;

public class Script_Instance : GH_ScriptInstance
{
  private void RunScript(Brep baseBrep, object y, out object resultGeometry)
  {
    if (baseBrep != null)
    {
        // For this example, the input Brep is directly set as the output.
        // In real scenarios, you would perform some operations on the input geometry.
        resultGeometry = baseBrep;
    }
    else
    {
        resultGeometry = null;
        Print("Please provide a valid Brep input.");
    }
  }
}
# ---------- end geometry_brep ----------
brep = Brep(geometry_brep.resultGeometry)
panel = Panel(geometry_brep.out)
panel_2 = Panel(brep)
