# Grasshopper definition Geometry_Circular_Arc.gh (Grasshopper 1.0.7)
# plug-ins: RhinoCodePluginGH

# ----
# Geometry Circular Arc
number_slider = Slider(0.7, range=0..2)
# gpt-4 Text Prompt
# Use this script editor template to create a script
#  for the C# node in grasshopper for rhino8 that
# models geometry for
# 
# a geometry
# 
# and specifically to
# 
# create a Param circular arc container
# 
# //Grasshopper Script Instance
# //#! csharp
# using System;
# using System.Collections;
# using System.Collections.Generic;
# using System.Drawing;
# 
# using Rhino;
# using Rhino.Geometry;
# 
# using Grasshopper;
# using Grasshopper.Kernel;
# using Grasshopper.Kernel.Data;
# using Grasshopper.Kernel.Types;
# 
# public class Script_Instance : GH_ScriptInstance
# {
#   /*
#     Members:
#       RhinoDoc RhinoDocument
#       GH_Document GrasshopperDocument
#       IGH_Component Component
#       int Iteration
# 
#     Methods (Virtual & overridable):
#       Print(string text)
#       Print(string format, params object[] args)
#       Reflect(object obj)
#       Reflect(object obj, string method_name)
#   */
# 
#   private void RunScript(object x, object y, out object a)
#   {
#     // Write your logic here
#     a = null;
#   }
# }
number_slider_2 = Slider(0.24, range=0..2)
construct_point = ConstructPoint(XCoordinate=0, YCoordinate=0, ZCoordinate=0)
pi = Pi(Factor=number_slider_2)
pi_2 = Pi(Factor=number_slider)
geometry_circular_arc = Script(center=construct_point, startAngle=pi, endAngle=pi_2, radius=Slider(3.83, range=0..10))  # -> out, outputArc; inputs center: Point3d, startAngle: Double, endAngle: Double, radius: Double
# ---------- geometry_circular_arc: C# ----------
// Grasshopper Script Instance
using System;
using System.Collections;
using System.Collections.Generic;
using System.Drawing;

using Rhino;
using Rhino.Geometry;

using Grasshopper;
using Grasshopper.Kernel;
using Grasshopper.Kernel.Data;
using Grasshopper.Kernel.Types;

public class Script_Instance : GH_ScriptInstance
{
  private void RunScript(
	Point3d center,
	double startAngle,
	double endAngle,
	double radius,
	out object outputArc)
  {
    // Validate inputs (optional but recommended)
    if (radius <= 0)
    {
      outputArc = Arc.Unset;
      Print("Invalid radius provided.");
      return;
    }

    // Calculate the arc based on the provided inputs
    Plane plane = new Plane(center, Vector3d.ZAxis);
    double angleDifference = endAngle - startAngle;
    
    // Create an arc with starting point, endpoint, and a point on the arc
    Point3d startPoint = center + radius * new Vector3d(Math.Cos(startAngle), Math.Sin(startAngle), 0);
    Point3d endPoint = center + radius * new Vector3d(Math.Cos(endAngle), Math.Sin(endAngle), 0);
    Point3d midPoint = center + radius * new Vector3d(Math.Cos(startAngle + angleDifference / 2), Math.Sin(startAngle + angleDifference / 2), 0);
    
    outputArc = new Arc(startPoint, midPoint, endPoint);
  }
}
# ---------- end geometry_circular_arc ----------
panel = Panel(geometry_circular_arc.out)
circular_arc = CircularArc(geometry_circular_arc.outputArc)
panel_2 = Panel(circular_arc)
