# Grasshopper definition Geometry_Curve.gh (Grasshopper 1.0.7)
# plug-ins: RhinoCodePluginGH

# ----
# gpt-4 Text Prompt
# Use this script editor template to create a script
#  for the C# node in grasshopper for rhino8 that
# models geometry for
# 
# a geometry
# 
# and specifically to
# 
# create a Param curve container
# 
# //Grasshopper Script Instance
# //#! csharp
# using System;
# using System.Collections;
# using System.Collections.Generic;
# using System.Drawing;
# 
# using Rhino;
# using Rhino.Geometry;
# 
# using Grasshopper;
# using Grasshopper.Kernel;
# using Grasshopper.Kernel.Data;
# using Grasshopper.Kernel.Types;
# 
# public class Script_Instance : GH_ScriptInstance
# {
#   /*
#     Members:
#       RhinoDoc RhinoDocument
#       GH_Document GrasshopperDocument
#       IGH_Component Component
#       int Iteration
# 
#     Methods (Virtual & overridable):
#       Print(string text)
#       Print(string format, params object[] args)
#       Reflect(object obj)
#       Reflect(object obj, string method_name)
#   */
# 
#   private void RunScript(object x, object y, out object a)
#   {
#     // Write your logic here
#     a = null;
#   }
# }
# Geometry Curve
number_slider = Slider(2, range=0..10)
construct_point = ConstructPoint(XCoordinate=number_slider, YCoordinate=Slider(3.44, range=0..10), ZCoordinate=Slider(4.99, range=0..10))
construct_point_2 = ConstructPoint(XCoordinate=Slider(10, range=0..10), YCoordinate=Slider(10, range=0..10), ZCoordinate=Slider(10, range=0..10))
construct_point_3 = ConstructPoint(XCoordinate=Slider(2, range=0..10), YCoordinate=Slider(3.44, range=0..10), ZCoordinate=Slider(8.31, range=0..10))
construct_point_4 = ConstructPoint(XCoordinate=Slider(10, range=0..10), YCoordinate=Slider(5.24, range=0..10), ZCoordinate=Slider(3.25, range=0..10))
geometry_curve = Script(pt1=construct_point, pt2=construct_point_2, pt3=construct_point_3, pt4=construct_point_4)  # -> out, a; inputs pt1: Point3d, pt2: Point3d, pt3: Point3d, pt4: Point3d
# ---------- geometry_curve: C# ----------
// Grasshopper Script Instance
using System;
using System.Collections;
using System.Collections.Generic;
using System.Drawing;

using Rhino;
using Rhino.Geometry;

using Grasshopper;
using Grasshopper.Kernel;
using Grasshopper.Kernel.Data;
using Grasshopper.Kernel.Types;

public class Script_Instance : GH_ScriptInstance
{ 
  private void RunScript(
	Point3d pt1,
	Point3d pt2,
	Point3d pt3,
	Point3d pt4,
	out object a)
  {
    // Create a list of points
    List<Point3d> controlPoints = new List<Point3d>() { pt1, pt2, pt3, pt4 };
    
    // Create a degree 3 NURBS curve using the control points
    a = NurbsCurve.Create(false, 3, controlPoints);
  }
}
# ---------- end geometry_curve ----------
panel = Panel(geometry_curve.out)
curve = Curve(geometry_curve.a)
panel_2 = Panel(curve)
