# Grasshopper definition Geometry_Extrusion.gh (Grasshopper 1.0.7)
# plug-ins: RhinoCodePluginGH

# ----
# Geometry Extrusion
number_slider = Slider(3.63, range=0..10)
# gpt-4 Text Prompt
# Use this script editor template to create a script
#  for the C# node in grasshopper for rhino8 that
# models geometry for
# 
# a geometry
# 
# and specifically to
# 
# create a Param Extrusion container
# 
# //Grasshopper Script Instance
# //#! csharp
# using System;
# using System.Collections;
# using System.Collections.Generic;
# using System.Drawing;
# 
# using Rhino;
# using Rhino.Geometry;
# 
# using Grasshopper;
# using Grasshopper.Kernel;
# using Grasshopper.Kernel.Data;
# using Grasshopper.Kernel.Types;
# 
# public class Script_Instance : GH_ScriptInstance
# {
#   /*
#     Members:
#       RhinoDoc RhinoDocument
#       GH_Document GrasshopperDocument
#       IGH_Component Component
#       int Iteration
# 
#     Methods (Virtual & overridable):
#       Print(string text)
#       Print(string format, params object[] args)
#       Reflect(object obj)
#       Reflect(object obj, string method_name)
#   */
# 
#   private void RunScript(object x, object y, out object a)
#   {
#     // Write your logic here
#     a = null;
#   }
# }
number_slider_2 = Slider(1.17, range=0..10)

circle = Circle(Plane=PlaneXY(0, 0, 0), Radius=number_slider_2)

geometry_extrusion = Script(baseCurve=circle, height=number_slider)  # -> out, extrudedGeometry; inputs baseCurve: Curve, height: Double
# ---------- geometry_extrusion: C# ----------
// Grasshopper Script Instance
using System;
using System.Collections;
using System.Collections.Generic;
using System.Drawing;

using Rhino;
using Rhino.Geometry;

using Grasshopper;
using Grasshopper.Kernel;
using Grasshopper.Kernel.Data;
using Grasshopper.Kernel.Types;

public class Script_Instance : GH_ScriptInstance
{
  private void RunScript(Curve baseCurve, double height, out object extrudedGeometry)
  {
    // Check if the input curve is not null
    if(baseCurve != null && !baseCurve.IsClosed)
    {
      Print("The base curve is not closed. Extrusion might not be solid.");
    }
    
    if (baseCurve != null)
    {
      extrudedGeometry = ExtrudeCurve(baseCurve, height);
    }
    else
    {
      extrudedGeometry = null;
      Print("Please provide a valid base curve for extrusion.");
    }
  }

  // Helper method to perform the extrusion
  private Brep ExtrudeCurve(Curve crv, double h)
  {
    Vector3d extrusionDirection = new Vector3d(0, 0, h); // Extruding in Z direction
    return Surface.CreateExtrusion(crv, extrusionDirection).ToBrep();
  }
}
# ---------- end geometry_extrusion ----------
panel = Panel(geometry_extrusion.out)

brep = Brep(geometry_extrusion.extrudedGeometry)

panel_2 = Panel(brep)
