# Grasshopper definition Geometry_Plane.gh (Grasshopper 1.0.7)
# plug-ins: RhinoCodePluginGH

# ----
# gpt-4 Text Prompt
# Use this script editor template to create a script
#  for the C# node in grasshopper for rhino8 that
# models geometry for
# 
# a geometry
# 
# and specifically to
# 
# create a Param plane container
# 
# //Grasshopper Script Instance
# //#! csharp
# using System;
# using System.Collections;
# using System.Collections.Generic;
# using System.Drawing;
# 
# using Rhino;
# using Rhino.Geometry;
# 
# using Grasshopper;
# using Grasshopper.Kernel;
# using Grasshopper.Kernel.Data;
# using Grasshopper.Kernel.Types;
# 
# public class Script_Instance : GH_ScriptInstance
# {
#   /*
#     Members:
#       RhinoDoc RhinoDocument
#       GH_Document GrasshopperDocument
#       IGH_Component Component
#       int Iteration
# 
#     Methods (Virtual & overridable):
#       Print(string text)
#       Print(string format, params object[] args)
#       Reflect(object obj)
#       Reflect(object obj, string method_name)
#   */
# 
#   private void RunScript(object x, object y, out object a)
#   {
#     // Write your logic here
#     a = null;
#   }
# }
# Geometry Plane
number_slider = Slider(0.89, range=0..10)
vector_xyz = VectorXYZ(XComponent=Slider(5.43, range=0..10), YComponent=Slider(3.99, range=0..10), ZComponent=Slider(10, range=0..10))  # -> Vector, Length
construct_point = ConstructPoint(XCoordinate=number_slider, YCoordinate=Slider(3.44, range=0..10), ZCoordinate=Slider(1.56, range=0..10))
geometry_plane = Script(origin=construct_point, direction=vector_xyz.Vector)  # -> out, plane; inputs origin: Point3d, direction: Vector3d
# ---------- geometry_plane: C# ----------
// Grasshopper Script Instance
using System;
using System.Collections;
using System.Collections.Generic;
using System.Drawing;

using Rhino;
using Rhino.Geometry;

using Grasshopper;
using Grasshopper.Kernel;
using Grasshopper.Kernel.Data;
using Grasshopper.Kernel.Types;

public class Script_Instance : GH_ScriptInstance
{
  private void RunScript(Point3d origin, Vector3d direction, out object plane)
  {
    if (direction.Length > 0)
    {
      plane = new Plane(origin, direction);
    }
    else
    {
      plane = Plane.Unset;
      Print("Direction vector is invalid.");
    }
  }
}
# ---------- end geometry_plane ----------
plane = Plane(geometry_plane.plane)
panel = Panel(geometry_plane.out)
panel_2 = Panel(plane)
