# Grasshopper definition Geometry_Point.gh (Grasshopper 1.0.7)
# plug-ins: RhinoCodePluginGH

# ----
# gpt-4 Text Prompt
# Use this script editor template to create a script
#  for the C# node in grasshopper for rhino8 that
# models geometry for
# 
# a geometry
# 
# and specifically to
# 
# create a Param point container
# 
# //Grasshopper Script Instance
# //#! csharp
# using System;
# using System.Collections;
# using System.Collections.Generic;
# using System.Drawing;
# 
# using Rhino;
# using Rhino.Geometry;
# 
# using Grasshopper;
# using Grasshopper.Kernel;
# using Grasshopper.Kernel.Data;
# using Grasshopper.Kernel.Types;
# 
# public class Script_Instance : GH_ScriptInstance
# {
#   /*
#     Members:
#       RhinoDoc RhinoDocument
#       GH_Document GrasshopperDocument
#       IGH_Component Component
#       int Iteration
# 
#     Methods (Virtual & overridable):
#       Print(string text)
#       Print(string format, params object[] args)
#       Reflect(object obj)
#       Reflect(object obj, string method_name)
#   */
# 
#   private void RunScript(object x, object y, out object a)
#   {
#     // Write your logic here
#     a = null;
#   }
# }
# Geometry Point
number_slider = Slider(2, range=0..10)
geometry_point = Script(x=number_slider, y=Slider(3.44, range=0..10), z=Slider(4.99, range=0..10))  # -> out, a; inputs x: Double, y: Double, z: Double
# ---------- geometry_point: C# ----------
// Grasshopper Script Instance
using System;
using System.Collections;
using System.Collections.Generic;
using System.Drawing;

using Rhino;
using Rhino.Geometry;

using Grasshopper;
using Grasshopper.Kernel;
using Grasshopper.Kernel.Data;
using Grasshopper.Kernel.Types;

public class Script_Instance : GH_ScriptInstance
{
  private void RunScript(double x, double y, double z, out object a)
  {
    // Create a Point3d from the input parameters
    Point3d pt = new Point3d(x, y, z);

    // Assign the Point3d to the output parameter
    a = pt;
  }
}
# ---------- end geometry_point ----------
panel = Panel(geometry_point.out)
point = Point(geometry_point.a)
panel_2 = Panel(point)
