# Grasshopper definition Geometry_Rectangle.gh (Grasshopper 1.0.7)
# plug-ins: RhinoCodePluginGH

# ----
# gpt-4 Text Prompt
# Geometry Rectangle
# Use this script editor template to create a script
#  for the C# node in grasshopper for rhino8 that
# models geometry for
# 
# a geometry
# 
# and specifically to
# 
# create a Param rectangle container
# 
# //Grasshopper Script Instance
# //#! csharp
# using System;
# using System.Collections;
# using System.Collections.Generic;
# using System.Drawing;
# 
# using Rhino;
# using Rhino.Geometry;
# 
# using Grasshopper;
# using Grasshopper.Kernel;
# using Grasshopper.Kernel.Data;
# using Grasshopper.Kernel.Types;
# 
# public class Script_Instance : GH_ScriptInstance
# {
#   /*
#     Members:
#       RhinoDoc RhinoDocument
#       GH_Document GrasshopperDocument
#       IGH_Component Component
#       int Iteration
# 
#     Methods (Virtual & overridable):
#       Print(string text)
#       Print(string format, params object[] args)
#       Reflect(object obj)
#       Reflect(object obj, string method_name)
#   */
# 
#   private void RunScript(object x, object y, out object a)
#   {
#     // Write your logic here
#     a = null;
#   }
# }
number_slider = Slider(0.89, range=0..10)
construct_point = ConstructPoint(XCoordinate=number_slider, YCoordinate=Slider(3.44, range=0..10), ZCoordinate=0)
geometry_rectangle = Script(origin=construct_point, width=Slider(5.43, range=0..10), height=Slider(4.18, range=0..10))  # -> out, a; inputs origin: Point3d, width: Double, height: Double
# ---------- geometry_rectangle: C# ----------
// Grasshopper Script Instance
using System;
using System.Collections;
using System.Collections.Generic;
using System.Drawing;

using Rhino;
using Rhino.Geometry;

using Grasshopper;
using Grasshopper.Kernel;
using Grasshopper.Kernel.Data;
using Grasshopper.Kernel.Types;

public class Script_Instance : GH_ScriptInstance
{ 
  private void RunScript(
	Point3d origin,
	double width,
	double height,
	out object a)
  {
    // Create a rectangle with the given origin, width, and height
    Rectangle3d rectangle = new Rectangle3d(Plane.WorldXY, origin, new Point3d(origin.X + width, origin.Y + height, origin.Z));
    
    // Output the rectangle
    a = rectangle;
  }
}
# ---------- end geometry_rectangle ----------
rectangle = Rectangle(geometry_rectangle.a)
panel = Panel(geometry_rectangle.out)
panel_2 = Panel(rectangle)
