# Grasshopper definition Geometry_Vector.gh (Grasshopper 1.0.7)
# plug-ins: RhinoCodePluginGH

# ----
# gpt-4 Text Prompt
# Use this script editor template to create a script
#  for the C# node in grasshopper for rhino8 that
# models geometry for
# 
# a geometry
# 
# and specifically to
# 
# create a Param vector container
# 
# //Grasshopper Script Instance
# //#! csharp
# using System;
# using System.Collections;
# using System.Collections.Generic;
# using System.Drawing;
# 
# using Rhino;
# using Rhino.Geometry;
# 
# using Grasshopper;
# using Grasshopper.Kernel;
# using Grasshopper.Kernel.Data;
# using Grasshopper.Kernel.Types;
# 
# public class Script_Instance : GH_ScriptInstance
# {
#   /*
#     Members:
#       RhinoDoc RhinoDocument
#       GH_Document GrasshopperDocument
#       IGH_Component Component
#       int Iteration
# 
#     Methods (Virtual & overridable):
#       Print(string text)
#       Print(string format, params object[] args)
#       Reflect(object obj)
#       Reflect(object obj, string method_name)
#   */
# 
#   private void RunScript(object x, object y, out object a)
#   {
#     // Write your logic here
#     a = null;
#   }
# }
# Geometry Vector
number_slider = Slider(2, range=0..10)
vector_xyz = VectorXYZ(XComponent=number_slider, YComponent=Slider(3.44, range=0..10), ZComponent=Slider(4.99, range=0..10))  # -> Vector, Length
vector_xyz_2 = VectorXYZ(XComponent=Slider(9.11, range=0..10), YComponent=Slider(10, range=0..10), ZComponent=Slider(10, range=0..10))  # -> Vector, Length
geometry_vector = Script(startVector=vector_xyz.Vector, endVector=vector_xyz_2.Vector)  # -> out, geometry; inputs startVector: Vector3d, endVector: Vector3d
# ---------- geometry_vector: C# ----------
// Grasshopper Script Instance
using System;
using System.Collections;
using System.Collections.Generic;
using System.Drawing;

using Rhino;
using Rhino.Geometry;

using Grasshopper;
using Grasshopper.Kernel;
using Grasshopper.Kernel.Data;
using Grasshopper.Kernel.Types;

public class Script_Instance : GH_ScriptInstance
{
  private void RunScript(
	Vector3d startVector,
	Vector3d endVector,
	out object geometry)
  {
    Point3d startPoint = new Point3d(startVector.X, startVector.Y, startVector.Z);
    Point3d endPoint = new Point3d(endVector.X, endVector.Y, endVector.Z);
    
    geometry = new Line(startPoint, endPoint);
  }
}
# ---------- end geometry_vector ----------
panel = Panel(geometry_vector.out)
line = Line(geometry_vector.geometry)
panel_2 = Panel(line)
